# Grasshopper definition Vault_Generator.gh (Grasshopper 1.0.7)
# plug-ins: MeshEdit Components

component_stem_height = Slider(50, range=10..80)
stem_slenderness = Slider(0.3, range=0.1..0.9)
shape_variation = Slider(2, range=0..10)
overall_height = Slider(10, range=5..10)
shape_size = Slider(60, range=20..60)
overall_height_5_10 = GetInteger(overall_height, AtLeast=1, AtMost=1, Maximum=2147483647, Minimum=-2147483648, TreeAccess=False)
shape_size_20_60 = GetInteger(shape_size, AtLeast=1, AtMost=1, Maximum=2147483647, Minimum=-2147483648, TreeAccess=False)
shape_variation_0_10 = GetInteger(shape_variation, AtLeast=1, AtMost=1, Maximum=2147483647, Minimum=-2147483648, TreeAccess=False)
component_stem_height_10_80 = GetInteger(component_stem_height, AtLeast=1, AtMost=1, Maximum=2147483647, Minimum=-2147483648, TreeAccess=False)
stem_slenderness_0_1_0_9 = GetNumber(stem_slenderness, AtLeast=1, AtMost=1, Maximum=1.797693135e+308, Minimum=-1.797693135e+308, TreeAccess=False)

# ----
# Shape
circle = Circle(Plane=PlaneXY(0, 0, 0), Radius=shape_size_20_60)
mesh = Mesh(circle)
populate_geometry = PopulateGeometry(Geometry=mesh, Count="15", Seed=shape_variation_0_10)
convex_hull_points = ConvexHullPoints(Points=populate_geometry)  # -> ConvexHull, Indices
interpolate = Interpolate(Vertices=convex_hull_points.ConvexHull, Degree=3, Periodic=True, KnotStyle=1)  # -> Curve, Length, Domain
unit_z = UnitZ(Factor=overall_height_5_10)
move = Move(Geometry=interpolate.Curve, Motion=unit_z)  # -> Geometry, Transform

floors = Brep(interpolate.Curve)
roof = Brep(move.Geometry)
area = Area(Geometry=roof)  # -> Area, Centroid
module_in_m2 = Panel("60")
division = Division(A=area.Area, B=module_in_m2)
qrsettings = QuadRemeshSettings(
    TargetCount=division,
    AdaptiveSize=0,
    AdaptiveCount=True,
    HardEdges=True,
    SeamEdges=Slider(2, range=0..2),
    Symmetry=0,
    GuideCurves=Slider(2, range=0..2))
qrmesh = QuadRemesh(Mesh=roof, Settings=qrsettings)
explode = MeshExplode(Mesh=qrmesh, Interpolate=False)
medges = MeshEdges(Mesh=explode)  # -> NakedEdges, InteriorEdges, NonManifoldEdges
join = JoinCurves(Curves=medges.NakedEdges, Preserve=False)
pcen = PolygonCenter(Polyline=join)  # -> CenterV, CenterE, CenterA
Z = UnitZ(Factor=1)
roof_centroids = Point(pcen.CenterV)
user_floors = Brep(floors)
neg = Negative(Value=Z)
project = ProjectPoint(Point=roof_centroids, Direction=neg, Geometry=user_floors)  # -> Point, Index
floor_centroids = Point(project.Point)
project_2 = Project(Geometry=join, Plane=floor_centroids)  # -> Geometry, Transform
floor_polylines = Curve(flatten(project_2.Geometry))
roof_polylines = Curve(flatten(join))

pcen_2 = PolygonCenter(Polyline=floor_polylines)  # -> CenterV, CenterE, CenterA
pcen_3 = PolygonCenter(Polyline=roof_polylines)  # -> CenterV, CenterE, CenterA
height_of_stem = Number(component_stem_height_10_80)
dom = ConstructDomain(DomainStart=0, DomainEnd=height_of_stem)
repeat = RepeatData(Data=stem_slenderness_0_1_0_9, Length="4")
range = Range(Domain=dom, Steps="4")  # -> reverse(Range)
scale = Scale(Geometry=floor_polylines, Center=pcen_2.CenterV, Factor=repeat)  # -> Geometry, Transform
pt = Point(pcen_2.CenterV)
item = ListItem(List=range, Index=0, Wrap=True)  # -> Item, Item1, Item2, Item3, Item4
pt_2 = Point(pcen_3.CenterV)
dist = Distance(PointA=pt_2, PointB=pt)
merge = Merge(
    Data1="100",
    Data2=flatten(item.Item),
    Data3=flatten(item.Item1),
    Data4=flatten(item.Item2),
    Data5=flatten(item.Item3),
    Data6=flatten(item.Item4))
dom_2 = ConstructDomain(DomainStart=0, DomainEnd=graft(dist))
bnd = Bounds(Numbers=merge)
remap = RemapNumbers(Value=merge, Source=bnd, Target=dom_2)  # -> Mapped, Clipped
Z_2 = UnitZ(Factor=remap.Mapped)
cull_i = CullIndex(List=Z_2, Indices="0", Wrap=True)  # -> simplify(List)
move_2 = Move(Geometry=graft(scale.Geometry), Motion=cull_i)  # -> Geometry, Transform
crv = Curve(move_2.Geometry)
crv_2 = Curve(roof_polylines)
merge_2 = Merge(Data1=simplify(graft(crv_2)), Data2=simplify(crv))
loft_opt = LoftOptions(Closed=False, Adjust=False, Rebuild=0, Refit=0, Type=0)
loft = Loft(Curves=merge_2, Options=loft_opt)

context_bake = ContextBake(Components=loft)
